# Dynamo graph Current Document Test.dyn (Dynamo 2.6.1.8786)
# packages: archi-lab.net 2023.213.1722, Clockwork for Dynamo 2.x 2.4.0

current = Document.Current()
watch = Watch(current)
current_document = Custom[Current Document]()  # package archi-lab.net; Retrieves Current Document
watch_2 = Watch(current_document)
activeViewFromCurrentDocument = Custom[Document.ActiveViewFromCurrentDocument]()  # package Clockwork for Dynamo 2.x; Gets the active view of the current document
watch_3 = Watch(activeViewFromCurrentDocument)
